# Grasshopper definition pilot.gh (Grasshopper 0.9.76)
# plug-ins: PhysX.GH

box = Box([{Plane=PlaneXY(-20.56428541, 31.44806267, 0), X=Domain(0, 7.257028152), Y=Domain(0, 5.555070982), Z=Domain(0, 2.810007873)}, {Plane=PlaneXY(-13.66725798, 17.80804747, 0), X=Domain(0, 8.919647364), Y=Domain(0, 5.635060921), Z=Domain(0, 3.7013066)}, {Plane=PlaneXY(-7.406211102, 28.57080018, 0), X=Domain(0, 8.152068115), Y=Domain(0, 3.827982749), Z=Domain(0, 7.174997399)}])
pt = Point([Point(16.16128143, -17.04234823, 3.128348391), Point(8.445872027, -16.48038178, 2.921541694), Point(12.04117357, -14.15378273, 0.8001142175), Point(16.44239446, -11.43803325, 2.037813939), Point(8.846567069, -5.322915594, 0.9749314729), Point(-1.120935131, -10.91586482, 3.45607463)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])
pt_2 = Point([Point(-40.15803409, 3.997381402, 16.7779267), Point(-13.03582559, 28.02306609, 21.10707081)])
move = Move(Geometry=pt, Motion=Vector(0, 0, 10))  # -> Geometry, Transform
shift = ShiftList(List=move.Geometry, Shift=1, Wrap=True)
shift_2 = ShiftList(List=move.Geometry, Shift=2, Wrap=True)
shift_3 = ShiftList(List=move.Geometry, Shift=3, Wrap=True)
move_2 = Move(Geometry=box, Motion=Vector(0, 0, 10))  # -> Geometry, Transform
volume = Volume(Geometry=move_2.Geometry)  # -> Volume, Centroid
pl_3pt = Plane3Pt(PointA=shift, PointB=shift_2, PointC=shift_3)
msphere = MeshSphere(Base=pt_2, Radius=Slider(3.9, range=0..10), UCount=[Slider(10, range=0..10), Slider(3, range=0..10)], VCount=20)
pt_3 = Point(Point(1.741963811, -0.9625506511, 38.20990456))
rotate = Rotate(
    Geometry=move_2.Geometry,
    Center=volume.Centroid,
    From=Vector(0, -6.725831902, 20.26835869),
    To=Vector(-3.525230684, 14.76452431, 0))  # -> Geometry, Transform
box_2 = Box([{Plane=PlaneXY(0, 0, 0), X=Domain(13.75560178, 19.03952228), Y=Domain(8.255932345, 35.33897183), Z=Domain(9.951708105, 13.78849541)}, {Plane=PlaneXY(0, 0, 0), X=Domain(13.75560178, 29.43917219), Y=Domain(25.89479833, 35.33897183), Z=Domain(7.062202614, 9.951708105)}, {Plane=PlaneXY(0, 0, 0), X=Domain(13.75560178, 23.31447217), Y=Domain(14.21620659, 31.48766897), Z=Domain(4.252124083, 7.062202614)}, {Plane=PlaneXY(0, 0, 0), X=Domain(13.75560178, 32.87334256), Y=Domain(14.21620659, 24.53755663), Z=Domain(0, 4.252124083)}])
msphere_2 = MeshSphere(Base=pt_3, Radius=Slider(3.9, range=0..10), UCount=10, VCount=20)
px_pilot2 = PXPilot2(Meshes=msphere_2)  # -> Statics, Dynamics
px_mat = PXMaterial(StaticFriction=0.5, DynamicFriction=0.5, Restitution=Slider(0.39, range=0..1))
px_cxmesh = PXConvexMesh(Mesh=msphere, Dynamic=True, MaterialProperty=px_mat)
px_box = PXBox(Base=[rotate.Geometry, box_2], Dynamic=[Toggle(False), Toggle(True)], MaterialProperty=px_mat)
px_sphere = PXSphere(BasePlane=pl_3pt, Radius=Slider(1, range=0..1), Dynamic=True, MaterialProperty=px_mat)
px_simulate = PXSimulate(
    RigidBodies=[px_pilot2.Statics, px_pilot2.Dynamics, px_cxmesh, px_box, px_sphere],
    Gravity=Vector(0, 0, -9.8),
    Timestep=0.01,
    Steps=Slider(23, range=0..100),
    Reset=Button(),
    Run=Toggle(False))  # -> Info, Dynamics, Statics
lng = ListLength(List=[px_simulate.Dynamics, px_simulate.Statics])
range = Range(Domain=Domain(0, 255), Steps=lng)
gradient = Gradient(
    LowerLimit=0,
    UpperLimit=255,
    Parameter=range,
    stops=[0: RGB(234, 38, 0), 0.25: RGB(234, 126, 0), 0.5: RGB(254, 244, 84), 0.75: RGB(173, 203, 249), 1: RGB(75, 107, 169)])
preview = CustomPreview(Geometry=[px_simulate.Statics, px_simulate.Dynamics], Shader=gradient)
panel = Panel(gradient)
