# Grasshopper definition simple_boxes_sequence.gh (Grasshopper 0.9.76)
# plug-ins: PhysX.GH

mesh = Mesh([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])
mesh_2 = Mesh([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])
box = Box({Plane=Plane(origin=(-202.8048279, -107.3109086, 0), x=(0, 1, 0), y=(1, 0, 0)), X=Domain(0, 296.7509898), Y=Domain(0, 321.4468639), Z=Domain(0, 1.110056111)})
mesh_3 = Mesh(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)
box_2 = Box([{Plane=PlaneXY(0, 0, 0), X=Domain(13.75560178, 19.03952228), Y=Domain(8.255932345, 35.33897183), Z=Domain(9.951708105, 13.78849541)}, {Plane=PlaneXY(0, 0, 0), X=Domain(13.75560178, 29.43917219), Y=Domain(25.89479833, 35.33897183), Z=Domain(7.062202614, 9.951708105)}, {Plane=PlaneXY(0, 0, 0), X=Domain(13.75560178, 23.31447217), Y=Domain(14.21620659, 31.48766897), Z=Domain(4.252124083, 7.062202614)}, {Plane=PlaneXY(0, 0, 0), X=Domain(13.75560178, 32.87334256), Y=Domain(14.21620659, 24.53755663), Z=Domain(0, 4.252124083)}])
px_mat = PXMaterial(StaticFriction=0.5, DynamicFriction=0.5, Restitution=Slider(0.235, range=0..1))
group = Group(Objects=mesh)
group_2 = Group(Objects=mesh_2)
px_ccxmesh = PXCompoConvexMesh(GroupMeshes=[group_2, group], Dynamic=True, MaterialProperty=px_mat)
px_cxmesh = PXConvexMesh(Mesh=mesh_3, Dynamic=True, MaterialProperty=px_mat)
px_box = PXBox(Base=box, Dynamic=False, MaterialProperty=px_mat)
px_box_2 = PXBox(Base=box_2, Dynamic=True, MaterialProperty=px_mat)
panel = Panel("""0
4
3
2
1
5
6
7""")
merge = Merge(Data1=px_box, Data2=px_box_2, Data3=px_cxmesh, Data4=px_ccxmesh)
px_simulateseq = PXSimulateSeq(
    RigidBodies=merge,
    Gravity=Vector(0, 0, -9.8),
    Timestep=0.01,
    Steps=Slider(21, range=0..100),
    ReSys=Toggle(False),
    Sequence=panel,
    Reset=Button(),
    Run=Toggle(False))  # -> Info, Dynamics, Statics, Stable
panel_2 = Panel(px_simulateseq.Stable)
lng = ListLength(List=[px_simulateseq.Dynamics, px_simulateseq.Statics])
panel_3 = Panel(px_simulateseq.Info)
range = Range(Domain=Domain(0, 255), Steps=expr("x-1", lng))
gradient = Gradient(
    LowerLimit=0,
    UpperLimit=255,
    Parameter=range,
    stops=[0: RGB(234, 38, 0), 0.25: RGB(234, 126, 0), 0.5: RGB(254, 244, 84), 0.75: RGB(173, 203, 249), 1: RGB(75, 107, 169)])
preview = CustomPreview(Geometry=[px_simulateseq.Dynamics, px_simulateseq.Statics], Shader=gradient)
