# Grasshopper definition simple_vault_sequence.gh (Grasshopper 0.9.76)
# plug-ins: PhysX.GH, Leopard version 0a1

mesh = Mesh([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])
lselgeo = LeopardsSelectGeometry(
    Geometry=mesh,
    lock=True,
    maintain=False,
    order=False,
    selectedobject="7|4|5|10|8|15|46|58|63|69|70|64|66|61|51|16|17|22|30|39|47|27|42|48|32|36|29|25|23|33|28|38|50|41")  # -> Geometry, Path, Index, Order
box = Box({Plane=Plane(origin=(-202.8048279, -107.3109086, 0), x=(0, 1, 0), y=(1, 0, 0)), X=Domain(0, 296.7509898), Y=Domain(0, 321.4468639), Z=Domain(0, 1.110056111)})
cull_i = CullIndex(List=mesh, Indices=lselgeo.Index, Wrap=True)
px_mat = PXMaterial(StaticFriction=0.5, DynamicFriction=0.5, Restitution=Slider(0.235, range=0..1))
px_box = PXBox(Base=box, Dynamic=False, MaterialProperty=px_mat)
px_cxmesh = PXConvexMesh(Mesh=cull_i, Dynamic=False, MaterialProperty=px_mat)
px_cxmesh_2 = PXConvexMesh(Mesh=lselgeo.Geometry, Dynamic=True, MaterialProperty=px_mat)
merge = Merge(Data1=simplify(flatten(px_box)), Data2=simplify(flatten(px_cxmesh)), Data3=simplify(flatten(px_cxmesh_2)))
lng = ListLength(List=merge)
series = Series(Start=0, Step=1, Count=lng)
int = Integer(series)
panel = Panel(int)
panel_2 = Panel(px_cxmesh_2)
px_simulateseq = PXSimulateSeq(
    RigidBodies=merge,
    Gravity=Vector(0, 0, -9.8),
    Timestep=0.01,
    Steps=Slider(21, range=0..100),
    ReSys=Toggle(False),
    Sequence=panel,
    Reset=Button(),
    Run=Toggle(False))  # -> Info, Dynamics, Statics, Stable
lng_2 = ListLength(List=px_simulateseq.Dynamics)
panel_3 = Panel(px_simulateseq.Stable)
panel_4 = Panel(px_simulateseq.Info)
range = Range(Domain=Domain(0, 255), Steps=expr("x-1", lng_2))
gradient = Gradient(
    LowerLimit=0,
    UpperLimit=255,
    Parameter=range,
    stops=[0: RGB(234, 38, 0), 0.25: RGB(234, 126, 0), 0.5: RGB(254, 244, 84), 0.75: RGB(173, 203, 249), 1: RGB(75, 107, 169)])
preview = CustomPreview(Geometry=px_simulateseq.Statics, Shader=ColourSwatch(SwatchColor=RGB(255, 108, 71)))
preview_2 = CustomPreview(Geometry=px_simulateseq.Dynamics, Shader=gradient)
