# Grasshopper definition compas_pattern_grasshopper_example.gh (Grasshopper 0.9.76)
# plug-ins: Python Interpreter

crv = Curve(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)
crv_2 = Curve(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)
crv_3 = Curve(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)
crv_4 = Curve(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)
edgesrf = EdgeSurface(CurveA=crv, CurveB=crv_2, CurveC=crv_4, CurveD=crv_3)
srf = Surface(edgesrf)
srf_2 = Surface(srf)
mesh = Mesh(<mesh referenced from the Rhino model>)
# singular
# by Robin OVAL
# from compas_pattern
# https://github.com/BlockResearchGroup/compas_pattern
mesh_2 = Mesh(<mesh referenced from the Rhino model>)

# ----
# from coarse quad mesh
# from quad mesh
# to coarse quad mesh
# from surface
# to coarse quad mesh
number_slider = Slider(0.6, range=0..1)
# INPUT DATA
python_script = PythonScript(mesh_guid=mesh_2)  # -> out, coarse_quad_mesh
# ---------- python_script: Python ----------
from compas_rhino.geometry import RhinoMesh
from compas_pattern.datastructures.mesh_quad_coarse import CoarseQuadMesh

coarse_quad_mesh = CoarseQuadMesh.from_vertices_and_faces(*RhinoMesh.from_guid(mesh_guid).get_vertices_and_faces())
coarse_quad_mesh.init_strip_density()
# ---------- end python_script ----------
python_script_2 = PythonScript(mesh_guid=mesh)  # -> out, coarse_quad_mesh
# ---------- python_script_2: Python ----------
from compas_rhino.geometry import RhinoMesh
from compas_pattern.datastructures.mesh_quad import QuadMesh
from compas_pattern.datastructures.mesh_quad_coarse import CoarseQuadMesh

coarse_quad_mesh = CoarseQuadMesh.from_quad_mesh(QuadMesh.from_vertices_and_faces(*RhinoMesh.from_guid(mesh_guid).get_vertices_and_faces()))
# ---------- end python_script_2 ----------
python = PythonScript(surface=srf_2, precision=number_slider)  # -> out, coarse_quad_mesh
# ---------- python: Python ----------
from compas_pattern.algorithms.skeletonisation import surface_skeleton_decomposition_mesh

coarse_quad_mesh = surface_skeleton_decomposition_mesh(surface, precision)
coarse_quad_mesh.init_strip_density()
# ---------- end python ----------

python_2 = PythonScript(quad_mesh_datastructure=python.coarse_quad_mesh)  # -> out, guid
# ---------- python_2: Python ----------
from compas_pattern.cad.rhino.utilities import draw_mesh

guid = draw_mesh(quad_mesh_datastructure, group = False)
# ---------- end python_2 ----------
mesh_3 = Mesh(python_2.guid)

# ----
# strip data
# delete strips
# add strips
# display vertex indices
polyedge = Panel("""12
11
10
16""")
python_3 = PythonScript(coarse_quad_mesh=python.coarse_quad_mesh)  # -> out, strip_polylines
# ---------- python_3: Python ----------
import rhinoscriptsyntax as rs

strip_polylines = [rs.AddPolyline(coarse_quad_mesh.strip_edge_polyline(skey)) for skey in coarse_quad_mesh.strips()]
# ---------- end python_3 ----------
genes = GenePool(Decimals=0, Maximum=1, Minimum=0, Value=[0, 0, 0, 0, 0, 0, 0, 0, 0, 0, 0, 0, 0, 0, 0.5, 0, 0.5, 0.5])
python_4 = PythonScript(coarse_quad_mesh=python.coarse_quad_mesh, polyedge=polyedge)  # -> out, added_coarse_quad_mesh; inputs polyedge: list of Int32
# ---------- python_4: Python ----------
from compas_pattern.topology.grammar import add_strip

added_coarse_quad_mesh = coarse_quad_mesh.copy()
added_coarse_quad_mesh.init_strip_density()

skey = add_strip(added_coarse_quad_mesh, polyedge)[0]
added_coarse_quad_mesh.set_strip_density(skey, 1)
# ---------- end python_4 ----------
python_5 = PythonScript(coarse_quad_mesh=python.coarse_quad_mesh, strip_booleans=genes)  # -> out, deleted_coarse_quad_mesh; inputs strip_booleans: list of Boolean
# ---------- python_5: Python ----------
import math
from compas_pattern.topology.grammar import delete_strips
from compas_pattern.topology.grammar import split_strip
from compas_pattern.topology.grammar import strips_to_split_to_preserve_boundaries_before_deleting_strips

strips = {i: skey for i, skey in enumerate(coarse_quad_mesh.strips())}
skeys = [skey for i, skey in enumerate(strips) if strip_booleans[i]]

deleted_coarse_quad_mesh = coarse_quad_mesh.copy()
deleted_coarse_quad_mesh.init_strip_density()

to_split = strips_to_split_to_preserve_boundaries_before_deleting_strips(deleted_coarse_quad_mesh, skeys)
for skey, n in to_split.items():
    skey_1, skey_2 = split_strip(deleted_coarse_quad_mesh, skey)
    d = int(math.ceil(float(deleted_coarse_quad_mesh.get_strip_density(skey)) / 2.))
    deleted_coarse_quad_mesh.set_strip_density(skey_1, d)
    deleted_coarse_quad_mesh.set_strip_density(skey_2, d)
delete_strips(deleted_coarse_quad_mesh, skeys)
# ---------- end python_5 ----------
python_6 = PythonScript(coarse_quad_mesh=python_5.deleted_coarse_quad_mesh)  # -> out, vertex_coordinates, vertex_keys
# ---------- python_6: Python ----------
import rhinoscriptsyntax as rs

vertex_keys = list(coarse_quad_mesh.vertices())

vertex_coordinates = ['{},{},{}'.format(*coarse_quad_mesh.vertex_coordinates(vkey)) for vkey in coarse_quad_mesh.vertices()]
# ---------- end python_6 ----------
lng = ListLength(List=python_3.strip_polylines)
tag = TextTag(Location=python_6.vertex_coordinates, Text=python_6.vertex_keys)
number_of_strips = Panel(lng)

python_7 = PythonScript(quad_mesh_datastructure=python.coarse_quad_mesh)  # -> out, guid; same code as python_2
# TOPOLOGY
mesh_4 = Mesh(python_7.guid)

# ----
# DENSITY
# global density target
# local density values
number_slider_2 = Slider(0.8, range=0..2)
genes_2 = GenePool(
    Decimals=0,
    Maximum=10,
    Minimum=1,
    Value=[5, 4, 5.929134929, 3.622746848, 1.971227642, 3, 3, 4, 10, 4, 1, 4, 2, 3.950256811, 4.368376244, 6, 7.289465084, 1])
python_8 = PythonScript(trimmed_coarse_quad_mesh=python_5.deleted_coarse_quad_mesh, density_target=number_slider_2)  # -> out, quad_mesh
# ---------- python_8: Python ----------
trimmed_coarse_quad_mesh.set_strips_density_target(density_target)
trimmed_coarse_quad_mesh.densification()
quad_mesh = trimmed_coarse_quad_mesh.quad_mesh
# ---------- end python_8 ----------
python_9 = PythonScript(trimmed_coarse_quad_mesh=python_5.deleted_coarse_quad_mesh, density_values=genes_2)  # -> out, quad_mesh; inputs density_values: list of Int32
# ---------- python_9: Python ----------
for i, skey in enumerate(trimmed_coarse_quad_mesh.strips()):
    trimmed_coarse_quad_mesh.set_strip_density(skey, density_values[i])
trimmed_coarse_quad_mesh.densification()
quad_mesh = trimmed_coarse_quad_mesh.quad_mesh
# ---------- end python_9 ----------

data = Data(python_5.deleted_coarse_quad_mesh)
python_10 = PythonScript(coarse_quad_mesh=data)  # -> out, strip_polylines; same code as python_3
python_11 = PythonScript(coarse_quad_mesh=data)  # -> out, strip_polylines; same code as python_3
pipe = Pipe(Curve=python_11.strip_polylines, Radius=Slider(0.25, range=0..1), Caps=0)
pipe_2 = Pipe(Curve=python_10.strip_polylines, Radius=Slider(0.25, range=0..1), Caps=0)

kmax = Slider(44, range=0..100)
damping = Slider(0.5, range=0..1)

# ----
# smooth quad mesh
# with constraints
# apply constraints
pt = Point()
# GEOMETRY - SMOOTHING
python_12 = PythonScript(quad_mesh=python_8.quad_mesh)  # -> out, constrained_quad_mesh, vertex_constraints, object_constraints; inputs points: list, curves: list
# ---------- python_12: Python ----------
import rhinoscriptsyntax as rs
from compas_pattern.cad.rhino.smoothing_constraints import automated_smoothing_constraints

constrained_quad_mesh = quad_mesh.copy()

points = list(set(points))
if points is not None and None in points:
        points.remove(None)

constraints = automated_smoothing_constraints(constrained_quad_mesh, points, curves, surface)

object_constraints = []
if surface is not None:
    object_constraints.append(surface)
if curves is not None:
    object_constraints += curves
if points is not None:
    object_constraints += points

for key, object in constraints.items():
    constraints[key] = object_constraints.index(object)

vertex_constraints = list(constraints.items())
# ---------- end python_12 ----------
python_13 = PythonScript(
    constrained_quad_mesh=python_12.constrained_quad_mesh,
    kmax=kmax,
    damping=damping,
    vertex_constraints=python_12.vertex_constraints,
    object_constraints=python_12.object_constraints)  # -> out, smooth_quad_mesh; inputs kmax: Int32, vertex_constraints: list, object_constraints: list
# ---------- python_13: Python ----------
from compas_pattern.algorithms.smoothing import constrained_smoothing

smooth_quad_mesh = constrained_quad_mesh.copy()

vertex_constraints = {key_object[0]: object_constraints[key_object[1]] for key_object in vertex_constraints}

constrained_smoothing(smooth_quad_mesh, kmax, damping, vertex_constraints, algorithm = 'area')
# ---------- end python_13 ----------

# ----
# Conway operators
list = ValueList({"dual", "join", "ambo", "kis", "needle", "zip", "truncate", "ortho", "expand", "gyro", "snub", "meta", "bevel"}, selected="gyro")
python_14 = PythonScript(seed_mesh=python_13.smooth_quad_mesh, operator=list)  # -> out, polygonal_mesh
# ---------- python_14: Python ----------
from compas.topology.conway import *

conway_operators = {'dual': conway_dual, 'join': conway_join, 'ambo': conway_ambo, 'kis': conway_kis, 'needle': conway_needle, 'zip': conway_zip, 'truncate': conway_truncate, 'ortho': conway_ortho, 'expand': conway_expand, 'gyro': conway_gyro, 'snub': conway_snub, 'meta': conway_meta, 'bevel': conway_bevel}

polygonal_mesh = conway_operators[operator](seed_mesh.copy())
# ---------- end python_14 ----------

python_15 = PythonScript(quad_mesh_datastructure=python_14.polygonal_mesh)  # -> out, guid; same code as python_2
crv_5 = Curve(python_15.guid)

# ----
# GEOMETRY - SMOOTHING
pt_2 = Point()
srf_3 = Surface()
crv_6 = Curve(<curve referenced from the Rhino model>)

kmax_2 = Slider(27, range=0..100)
damping_2 = Slider(0.5, range=0..1)

# ----
# smooth quad mesh
# with constraints
# apply constraints
python_16 = PythonScript(quad_mesh=python_14.polygonal_mesh)  # -> out, constrained_quad_mesh, vertex_constraints, object_constraints; inputs points: list, curves: list; same code as python_12
python_17 = PythonScript(
    constrained_quad_mesh=python_16.constrained_quad_mesh,
    kmax=kmax_2,
    damping=damping_2,
    vertex_constraints=python_16.vertex_constraints,
    object_constraints=python_16.object_constraints)  # -> out, smooth_quad_mesh; inputs kmax: Int32, vertex_constraints: list, object_constraints: list; same code as python_13

# ----
# OUTPUT DATA
# from quad mesh
# to quad mesh guid
# from polygonal mesh
# to line guids
python_18 = PythonScript()  # -> out, guid; same code as python_2
# SYMMETRY
python_19 = PythonScript(polygonal_mesh_datastructure=python_17.smooth_quad_mesh)  # -> out, guids
# ---------- python_19: Python ----------
from compas_pattern.cad.rhino.utilities import draw_mesh

guids = draw_mesh(polygonal_mesh_datastructure, group = False)
# ---------- end python_19 ----------

mesh_5 = Mesh(python_18.guid)
geo = Geometry(python_19.guids)
