# Grasshopper definition planarization_kangaroo.gh (Grasshopper 0.9.76)
# plug-ins: Python Interpreter, Kangaroo2 Components, Leopard version 0a1

mesh = Mesh(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)
mesh_2 = Mesh([<mesh referenced from the Rhino model> x6])
clean = CombineClean(Meshes=graft(mesh_2))
clean_2 = CombineClean(Meshes=mesh)
l_selfaces = LeopardsSelectMeshFaces(Mesh=clean, lock=True, maintain=False, order=False, selectedobject="25|13|19|12|15|14|27|20|29")  # -> Geometry, Index
clean_3 = CombineClean(Meshes=mesh_2)
planarize = Planarize(M=clean_2, Strength=1)
show = Show(G=clean_2)
l_facenb = LeopardsFaceNeighbours(Mesh=clean, Face=l_selfaces.Index)  # -> ThisFace, FaceVertices, FaceNeighbourEdges, FaceNeighbourFaces
conmesh = ConstructMesh(Vertices=l_facenb.FaceVertices, Faces={A=0, B=1, C=2, D=3})  # -> flatten(Mesh)
solver = Solver(GoalObjects=[planarize, show], Reset=Button(), Threshold=1e-15, Tolerance=0.01, On=Toggle(False))  # -> I, V, flatten(O)
clean_4 = CombineClean(Meshes=conmesh)
panel = Panel(conmesh)
planarize_2 = Planarize(M=clean_4, Strength=1)
show_2 = Show(G=mesh_2)
python = PythonScript(x=solver.O)  # -> out, a; inputs x: list
# ---------- python: Python ----------
import rhinoscriptsyntax as rs

a = []

for xi in x:
    if rs.IsMesh(xi):
        a.append(xi)
# ---------- end python ----------
panel_2 = Panel(python.a)
solver_2 = Solver(GoalObjects=[planarize_2, show_2], Reset=Button(), Threshold=1e-15, Tolerance=0.01, On=Toggle(False))  # -> I, V, flatten(O)
demesh = DeconstructMesh(Mesh=python.a)  # -> Vertices, Faces, Colours, Normals
conmesh_2 = ConstructMesh(Vertices=demesh.Vertices, Faces=demesh.Faces)  # -> flatten(Mesh)
python_2 = PythonScript(x=solver_2.O)  # -> out, a; inputs x: list; same code as python
demesh_2 = DeconstructMesh(Mesh=python_2.a)  # -> Vertices, Faces, Colours, Normals
planaritydisplay = PlanarityDisplay(M=conmesh_2, I="0 To 0.000005", bool=True)  # -> num_2, M_2, C
conmesh_3 = ConstructMesh(Vertices=demesh_2.Vertices, Faces=demesh_2.Faces)  # -> flatten(Mesh)
preview = CustomPreview(Geometry=planaritydisplay.M_2, Shader=planaritydisplay.C)
planaritydisplay_2 = PlanarityDisplay(M=conmesh_3, I="0 To 0.000005", bool=True)  # -> num_2, M_2, C
preview_2 = CustomPreview(Geometry=planaritydisplay_2.M_2, Shader=planaritydisplay_2.C)

# ==== cluster PlanarityDisplay: Creates colours for each face of a mesh, showing planarity levels
I = ClusterInput()
M = ClusterInput()
bool = ClusterInput()
domcomp = DomainComponents(Domain=I)  # -> Start, End
mcomp = Decompose(Mesh=M)  # -> Vertices, Faces, Colours, Normals
bool_2 = Boolean(bool)
vertices = FaceVertices(Face=mcomp.Faces)  # -> CornerA, CornerB, CornerC, CornerD
item = ListItem(List=mcomp.Vertices, Index=vertices.CornerA, Wrap=False)
item_2 = ListItem(List=mcomp.Vertices, Index=vertices.CornerB, Wrap=False)
item_3 = ListItem(List=mcomp.Vertices, Index=vertices.CornerC, Wrap=False)
item_4 = ListItem(List=mcomp.Vertices, Index=vertices.CornerD, Wrap=False)
quad = MeshQuad(CornerA=0, CornerB=1, CornerC=3, CornerD=2)
entwine = Entwine(Branch00=item, Branch01=item_2, Branch02=item_4, Branch03=item_3, FlattenInputs=True)
flip = FlipMatrix(Data=entwine)
dist = Distance(PointA=item_2, PointB=item_4)
dist_2 = Distance(PointA=item, PointB=item_3)
P = Planarity(Point1=item, Point2=item_2, Point3=item_3, Point4=item_4)  # -> flatten(Height)
mesh = Mesh(Vertices=flip, Faces=quad)  # -> flatten(Mesh)
avr = Average(Input=[dist_2, dist])  # -> flatten(ArithmeticMean)
M_2 = ClusterOutput(mesh)
division = Division(A=P, B=avr)
filter = StreamFilter(Gate=bool_2, Stream0=division, Stream1=P)  # -> flatten(Stream)
gradient = Gradient(
    LowerLimit=domcomp.Start,
    UpperLimit=domcomp.End,
    Parameter=filter,
    stops=[0: RGB(0, 128, 0), 0.5: RGB(255, 255, 0), 1: RGB(255, 0, 0)])
num = Number(filter)
C = ClusterOutput(gradient)
num_2 = ClusterOutput(num)
