# Grasshopper definition british_museum.gh (Grasshopper 0.9.76)
# plug-ins: PhysX.GH, Leopard version 0a1

mesh = Mesh([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])
px_mat = PXMaterial(StaticFriction=0.5, DynamicFriction=0.5, Restitution=Slider(0.54, range=0..1))
lselgeo = LeopardsSelectGeometry(
    Geometry=mesh,
    lock=True,
    maintain=False,
    order=False,
    selectedobject="257|256|255|254|253|252|251|250|249|248|247|246|245|219|210|178|176|173|166|161|160|154|145|143|141|131|130|123|121|114|109|107|103|96|94|91|88|85|80|79|70|44|33|8|7|6|5|4|3|2|1|0")  # -> Geometry, Path, Index, Order
cull_i = CullIndex(List=mesh, Indices=lselgeo.Index, Wrap=True)
B = Base({Plane=Plane(origin=(-9.375577852, -7.04276371, 0), x=(0, 1, 0), y=(1, 0, 0)), X=Domain(0, 37.66596108), Y=Domain(0, 34.8002414), Z=Domain(0, 0.7688135912)})
px_cxmesh = PXConvexMesh(Mesh=lselgeo.Geometry, Dynamic=False, MaterialProperty=px_mat)
px_cxmesh_2 = PXConvexMesh(Mesh=cull_i, Dynamic=True, MaterialProperty=px_mat)
px_box = PXBox(Base=B, Dynamic=False, MaterialProperty=px_mat)
px_simulate = PXSimulate(
    RigidBodies=[px_cxmesh, px_cxmesh_2, px_box],
    Gravity=Vector(0, 0, -9.8),
    Timestep=Slider(0.0046, range=0..0.01),
    Steps=Slider(1, range=0..100),
    Reset=Button(),
    Run=Toggle(False))  # -> Info, Dynamics, Statics
merge = Merge(Data1=cull_i, Data2=lselgeo.Geometry)  # -> simplify(Result)
viewer = ParamViewer(merge)
shift = ShiftList(List=px_simulate.Statics, Shift=1, Wrap=False)
panel = Panel(merge)
pshift = ShiftPaths(Data=shift, Offset=-2)
panel_2 = Panel(px_simulate.Info)
merge_2 = Merge(Data1=px_simulate.Dynamics, Data2=pshift)
volume = Volume(Geometry=merge)  # -> Volume, Centroid
volume_2 = Volume(Geometry=merge_2)  # -> Volume, Centroid
viewer_2 = ParamViewer(pshift)
panel_3 = Panel(merge_2)
dist = Distance(PointA=volume.Centroid, PointB=volume_2.Centroid)
sort = SortList(Keys=dist, ValuesA=dist)  # -> Keys, ValuesA
item = ListItem(List=sort.ValuesA, Index=0, Wrap=True)  # -> Item1, Item
gradient = Gradient(
    LowerLimit=item.Item,
    UpperLimit=item.Item1,
    Parameter=dist,
    stops=[0: RGB(234, 38, 0), 0.25: RGB(234, 126, 0), 0.5: RGB(254, 244, 84), 0.75: RGB(173, 203, 249), 1: RGB(75, 107, 169)])
panel_4 = Panel(dist)
preview = CustomPreview(Geometry=merge_2, Shader=gradient)
