# Grasshopper definition tower.gh (Grasshopper 0.9.76)
# plug-ins: PhysX.GH

srf = Surface(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)
mesh = Mesh([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])
mesh_2 = Mesh([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])
geo = Geometry(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)
box = Box({Plane=Plane(origin=(-388, -513, 0), x=(0, 1, 0), y=(1, 0, 0)), X=Domain(0, 930), Y=Domain(0, 699), Z=Domain(0, 16)})
sdivide = DivideSurface(Surface=srf, UCount=10, VCount=10)  # -> Points, Normals, Parameters
mesh_3 = MeshBrep(
    Brep=geo,
    Settings={GridMaxCount=0, GridMinCount=16, JaggedSeams=False, MaxEdgeLength=0, MinEdgeLength=0.0001, MinTolerance=0, Refine=True, RefineAngle=0, RelativeTolerance=0.65, SimplePlanes=True, Tolerance=0})
px_mat = PXMaterial(StaticFriction=0.5, DynamicFriction=0.5, Restitution=Slider(0, range=0..1))
mesh_4 = Mesh([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])
panel = Panel(px_mat)
px_box = PXBox(Base=[box, mesh_3], Dynamic=[Toggle(False), Toggle(True)], MaterialProperty=px_mat)
px_cxmesh = PXConvexMesh(Mesh=mesh_4, Dynamic=True)
px_simulate = PXSimulate(
    RigidBodies=flatten([px_cxmesh, px_box]),
    Gravity=Vector(0, 0, -9.8),
    Timestep=0.01,
    Steps=Slider(23, range=0..100),
    Reset=Button(),
    Run=Toggle(False))  # -> Info, Dynamics, Statics
panel_2 = Panel(px_simulate.Info)
