# Grasshopper definition simple_optimisation_example.gh (Grasshopper 0.9.76)
# plug-ins: goat

number_slider = Slider(-2, range=-2..2)
expression = Expression(x=number_slider, Expression="(x-2)^2")
goat = Goat(fitness=data, gene=number_slider)
data = Data(expression)
galapagos = Galapagos(fitness=data, gene=number_slider)
