# Grasshopper definition 01_physx_simulate.gh (Grasshopper 0.9.76)
# plug-ins: PhysX.GH, Leopard version 0a1

mesh = Mesh([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])
number_slider = Slider(0.991, range=0..1)
lselgeo = LeopardsSelectGeometry(
    Geometry=mesh,
    lock=True,
    maintain=False,
    order=False,
    selectedobject="424|420|417|416|398|385|375|368|365|357|354|347|336|333|330|317|305|299|297|271|254|246|234|231|230|219|218|185|184|168|167|166|138|137|136|81|66|65|73|165|233|367|284|328")  # -> Geometry, Path, Index, Order
box = Box({Plane=Plane(origin=(-202.8048279, -107.3109086, 0), x=(0, 1, 0), y=(1, 0, 0)), X=Domain(0, 296.7509898), Y=Domain(0, 321.4468639), Z=Domain(0, 1.110056111)})
px_mat = PXMaterial(StaticFriction=number_slider, DynamicFriction=number_slider, Restitution=0.5)
cull_i = CullIndex(List=mesh, Indices=lselgeo.Index, Wrap=True)
px_cxmesh = PXConvexMesh(Mesh=lselgeo.Geometry, Dynamic=False, MaterialProperty=px_mat)
px_cxmesh_2 = PXConvexMesh(Mesh=cull_i, Dynamic=True, MaterialProperty=px_mat)
px_box = PXBox(Base=box, Dynamic=False)
px_simulate = PXSimulate(
    RigidBodies=[px_box, px_cxmesh_2, px_cxmesh],
    Gravity=Vector(0, 0, -9.8),
    Timestep=0.01,
    Steps=Slider(1, range=0..100),
    Reset=Button(),
    Run=Toggle(False))  # -> Info, Dynamics, Statics
lng = ListLength(List=[px_simulate.Dynamics, px_simulate.Statics])
range = Range(Domain=Domain(0, 255), Steps=expr("x-1", lng))
gradient = Gradient(
    LowerLimit=0,
    UpperLimit=255,
    Parameter=range,
    stops=[0: RGB(234, 38, 0), 0.25: RGB(234, 126, 0), 0.5: RGB(254, 244, 84), 0.75: RGB(173, 203, 249), 1: RGB(75, 107, 169)])
preview = CustomPreview(Geometry=[px_simulate.Dynamics, px_simulate.Statics], Shader=gradient)
