# Grasshopper definition bending simulation.gh (Grasshopper 1.0.4)
# plug-ins: Millipede, Kangaroo2 Components

srf = Surface(<surface referenced from the Rhino model>)
mesh_uv = MeshSurface(Surface=srf, UCount="25", VCount="5", Overhang=True, Equalize=False)
discretization = Discretization(Breps=srf, Tolerance=0.001, MeshSize="15", Iterations=500, Beta=1.414213562)  # -> Meshes, Curves
demesh = DeconstructMesh(Mesh=discretization.Meshes)  # -> Vertices, Faces, Colours, Normals
faceb = FaceBoundaries(Mesh=discretization.Meshes)

crv = Curve([<curve referenced from the Rhino model> x15])
length_line = LengthLine(Line=crv, Length=0, Strength=Slider(2, range=0..222220))

toggle = BooleanToggle(False)
pt = Point([<point referenced from the Rhino model> x15])
anchorxyz = AnchorXYZ(Point=pt, X=toggle, Y=toggle, Z=Toggle(True), Strength=1000)

hingepoints = HingePoints(Mesh=discretization.Meshes)  # -> _1, _2, _3, _4
hinge = Hinge(
    FoldStart=hingepoints._1,
    FoldEnd=hingepoints._2,
    Tip1=hingepoints._3,
    Tip2=hingepoints._4,
    Strength=Slider(2000, range=0..2000))

toggle_2 = BooleanToggle(True)
pt_2 = Point([<point referenced from the Rhino model> x17])
anchorxyz_2 = AnchorXYZ(Point=pt_2, X=toggle_2, Y=toggle_2, Z=toggle_2, Strength=1000)

explode = Explode(Curve=faceb, Recursive=True)  # -> flatten(Segments), Vertices
dupln = RemoveDuplicateLines(Lines=explode.Segments, Tolerance=0.01)
len = Length(Curve=dupln)
length_line_2 = LengthLine(Line=dupln, Length=len, Strength="2000")

end = EndPoints(Curve=explode.Segments)  # -> Start, End
duppt = RemoveDuplicatePts(Points=flatten([end.Start, end.End]), Tolerance=0.01)
Z = UnitZ(Factor=Slider(5, range=0..10))
load = Load(Point=duppt, ForceVector=Z)

show = Show(G=discretization.Meshes)
solver = Solver(
    GoalObjects=flatten([length_line_2, show, length_line, anchorxyz_2, load, hinge, anchorxyz]),
    Reset=Toggle(False),
    Threshold=1e-15,
    Tolerance=0.01,
    On=Toggle(True))  # -> I, V, O
panel = Panel(solver.V)
panel_2 = Panel(solver.I)
