# Grasshopper definition principal stress line board.gh (Grasshopper 0.9.76)
# plug-ins: Karamba

mesh = Mesh(<mesh referenced from the Rhino model>)

# ----
# Karamba Input
panel = Panel("shell")
meshtoshell = MeshToShellKaramba(Mesh=mesh, LDist=0.005, Identifier=panel)  # -> Point, Element, Info
rdpoints = RemoveDuplicatePointsKaramba(Point=meshtoshell.Point, LDist=0.005)  # -> OutPoint, Info, Indexes
points = PointList(Points=rdpoints.OutPoint, Size=Slider(0.116, range=0..1))

pt = Point(rdpoints.OutPoint)
pdecon = Deconstruct(Point=pt)  # -> XComponent, YComponent, ZComponent

# ---- group: find lowest x value
sort = SortList(Keys=pdecon.XComponent)  # -> Keys, ValuesA
item = ListItem(List=sort.Keys, Index="0", Wrap=True)

# ---- group: find all points with the same x value
smaller = SmallerThan(FirstNumber=pdecon.XComponent, SecondNumber=item)  # -> SmallerThan, OrEqualTo
cull = CullPattern(List=pt, CullPattern=smaller.OrEqualTo)

# ----
point = Point([Point(6956.967285, -279.2671204, 0), Point(6956.967285, -398.1356773, 0), Point(6956.967285, -517.0042343, 0), Point(6956.967285, -635.8727913, 0), Point(6956.967285, -754.7413483, 0), Point(6956.967285, -873.6099052, 0), Point(6956.967285, -992.4784622, 0), Point(6956.967285, -1111.347019, 0), Point(6956.967285, -1230.215576, 0)])

# ---- group: END X supports
supp = SupportKaramba(PosInd=cull, menu=[buttons(on, on, on, on, on, off)])

# ---- group: (OPTIONAL) apply cross-section
cross_sections = CrossSectionsKaramba(ElementsIdentifiers="shell", Heights_in=Slider(4, range=0..10), mode="Shell")

# ---- group: point load applied in negative z axis (vertical load) / extreme load magnitude to show results
live_load = Slider(-9.832, range=-50..-0.04)

# ---- group: point load applied in x axis (lateral load) / extreme load magnitude to show results
live_load_2 = Slider(-4.152, range=-50..-0.04)

# ----
# ALTERNATE support input between
# points on the bottom (lowest z value) and
# either end (extreme x values) of the shell
# by plugging in a different support component on the left
support = SupportKaramba(supp)

# ---- group: point load applied in negative z axis (vertical load)
Z = UnitZ(Factor=live_load)
loads = LoadsKaramba(ForceVector=Z, Local=True, LCase=0, mode="Point")

# ---- group: point load applied in x axis (lateral load)
Z_2 = UnitZ(Factor=live_load_2)
loads_2 = LoadsKaramba(ForceVector=Z_2, Local=True, LCase=0, mode="Point")

# ----
pt_2 = Point([<point referenced from the Rhino model> x17])
panel_2 = Panel("""0
1""")
panel_3 = Panel("""0
0
1""")
panel_4 = Panel("1")
unit_z = UnitZ(Factor=1)

# ---- group: reduce mesh point density with cull pattern
panel_5 = Panel("""0
0
0
0
1""")
cull_2 = CullPattern(List=rdpoints.OutPoint, CullPattern=pt_2)

# ----
join_curves = JoinCurves(Preserve=False)

# ----
# This definition is only visualizing analysis results; results are not used to make changes or perform further design operations.
panel_6 = Panel("250")

rebuild_curve = RebuildCurve(Curve=join_curves, Degree=Slider(3, range=0..10), Count=Slider(10, range=0..10), Tangents=False)

# ---- group: red
rgb = ColourRGB(Alpha=255, Red=panel_6, Green=0, Blue=0)
preview = CustomPreview(Shader=rgb)

# ---- group: dead load
panel_7 = Panel("-1")

# ----
unit_y = UnitY(Factor=panel_7)

# ---- group: dead load (continued)
loads_3 = LoadsKaramba(ForceVector=unit_y, Local=True, PosInd=point, LCase=0, mode="Point")
panel_8 = Panel(loads_3)

# ----
# ALTERNATE loads between vertical and lateral
# by plugging in a different load component below
load = LoadKaramba(flatten(loads_3))

# ---- group: assemble elements and analyze
assemble = AssembleModelKaramba(Elem=meshtoshell.Element, Support=support, Load=load, LimitDistance_m=0.005)  # -> Model, Info, Mass_kg, CenterOfGravity
analyzethi = AnalyzeThIKaramba(Model=assemble.Model)  # -> CalculatedModel, MaximumDisplacement_m, ResultingForceOfGravity_kN, ElasticEnergy_kNm

# ----
# Karamba Output
# NOTE:
# If you want to SEE the deformation with the shell visualization,  plug in ShellView AFTER ModelView. The numerical data is the SAME if you plug BeamView directly into the Analyze component.
modelview = ModelViewKaramba(Model=analyzethi.CalculatedModel, LoadCaseFactorsForLinearSuperposition=1, IndexIncrementOfVisibleLoadcase=0)  # -> Model, DeformedMesh, DeformedAxes, DeformedModel

# ---- group: max displacement for the model
panel_9 = Panel(analyzethi.MaximumDisplacement_m)

# ----
shellview = ShellViewKaramba(Model=modelview.Model)  # -> Model, MeshesOfRenderedShells, LegendColors, LegendTags
legend = Legend(Colour=shellview.LegendColors, Tags=shellview.LegendTags, LegendType=1)

# ---- group: map principal stress lines at each point
shelllineresults = LineResultsOnShellsKaramba(
    AnalyzedModel=shellview.Model,
    Layer="0",
    ListOfSourcesOfPrincipalStressLinesLinesPoints=pt_2,
    SegmentLength_m="0.4",
    DA_deg="0.4",
    mode="PrincStress")  # -> AnalyzedModel, Lines1, Lines2

# ----
join_curves_2 = JoinCurves(Curves=[shelllineresults.Lines2, shelllineresults.Lines1], Preserve=False)
rebuild_curve_2 = RebuildCurve(Curve=join_curves_2, Degree=Slider(3, range=0..10), Count=Slider(20, range=0..20), Tangents=False)

# ---- group: blue
rgb_2 = ColourRGB(Alpha=shelllineresults.Lines1, Red=0, Green=0, Blue=panel_6)
preview_2 = CustomPreview(Shader=rgb_2)

# ----
crv = Curve(shelllineresults.Lines1)
crv_2 = Curve(shelllineresults.Lines2)
