# Grasshopper definition principal stress line.gh (Grasshopper 0.9.76)
# plug-ins: Karamba

pt = Point([Point(-3.780516299, 2334.55407, 25.50697174), Point(-3.774664611, 2183.030423, 25.50697174), Point(1814.583502, 364.8364938, 25.50697174), Point(1966.102776, 364.8434137, 25.50697174), Point(2117.626833, 364.850897, 25.50697174), Point(3935.821888, 2183.204844, 25.50697174), Point(3935.816036, 2334.727961, 25.50697174)])
mesh = Mesh(<mesh referenced from the Rhino model>)

# ---- group: dead load
Z = UnitZ(Factor="-1")
loads = LoadsKaramba(Vector=Z, LCase=0, mode="Gravity")
panel = Panel(loads)

# ---- group: LOWEST Z supports
supp = SupportKaramba(PosInd=pt, menu=[buttons(on, on, on, off, off, off)])

# ----
# Karamba Input
meshtoshell = MeshToShellKaramba(Mesh=mesh, LDist=0.005, Identifier="shell")  # -> Point, Element, Info
unit_z = UnitZ(Factor=Slider(100, range=0..100))
point = Point(Point(2193.367649, 895.1837456, 1490.292279))

# ----
# ALTERNATE support input between
# points on the bottom (lowest z value) and
# either end (extreme x values) of the shell
# by plugging in a different support component on the left
support = SupportKaramba(supp)

rdpoints = RemoveDuplicatePointsKaramba(Point=meshtoshell.Point, LDist=0.005)  # -> OutPoint, Info, Indexes
loads_karamba = LoadsKaramba(ForceVector=unit_z, Local=False, PosInd=point, LCase=0, mode="Point")  # disabled
pt_2 = Point(rdpoints.OutPoint)
points = PointList(Points=rdpoints.OutPoint, Size=Slider(0.116, range=0..1))

# ----
# ALTERNATE loads between vertical and lateral
# by plugging in a different load component below
load = LoadKaramba(flatten([loads, loads_karamba]))

# ---- group: assemble elements and analyze
assemble = AssembleModelKaramba(Elem=meshtoshell.Element, Support=support, Load=load, LimitDistance_m=0.005)  # -> Model, Info, Mass_kg, CenterOfGravity
analyzethi = AnalyzeThIKaramba(Model=assemble.Model)  # -> CalculatedModel, MaximumDisplacement_m, ResultingForceOfGravity_kN, ElasticEnergy_kNm

# ----
# Karamba Output
# NOTE:
# If you want to SEE the deformation with the shell visualization,  plug in ShellView AFTER ModelView. The numerical data is the SAME if you plug BeamView directly into the Analyze component.
modelview = ModelViewKaramba(Model=analyzethi.CalculatedModel, LoadCaseFactorsForLinearSuperposition=1, IndexIncrementOfVisibleLoadcase=0)  # -> Model, DeformedMesh, DeformedAxes, DeformedModel

# ---- group: max displacement for the model
panel_2 = Panel(analyzethi.MaximumDisplacement_m)

# ----
shellview = ShellViewKaramba(Model=modelview.Model)  # -> Model, MeshesOfRenderedShells, LegendColors, LegendTags
legend = Legend(Colour=shellview.LegendColors, Tags=shellview.LegendTags, LegendType=1)
panel_3 = Panel("""0
1""")
panel_4 = Panel("1")
panel_5 = Panel("0")

# ---- group: reduce mesh point density with cull pattern
panel_6 = Panel("""0
0
0
1""")
cull = CullPattern(List=rdpoints.OutPoint, CullPattern=panel_6)

# ----
Z_2 = UnitZ(Factor=1)
pt_3 = Point([<point referenced from the Rhino model> x82])

# ---- group: map principal stress lines at each point
shelllineresults = LineResultsOnShellsKaramba(
    AnalyzedModel=shellview.Model,
    Layer="-1",
    ListOfSourcesOfPrincipalStressLinesLinesPoints=pt_3,
    SegmentLength_m="0.2",
    DA_deg="0.2",
    mode="PrincStress")  # -> AnalyzedModel, Lines1, Lines2

# ----
crv = Curve()
crv_2 = Curve()

# ----
# This definition is only visualizing analysis results; results are not used to make changes or perform further design operations.
panel_7 = Panel("250")

# ---- group: blue
rgb = ColourRGB(Alpha=255, Red=0, Green=0, Blue=panel_7)
preview = CustomPreview(Shader=rgb)

# ---- group: red
rgb_2 = ColourRGB(Alpha=255, Red=panel_7, Green=0, Blue=0)
preview_2 = CustomPreview(Shader=rgb_2)
