# Grasshopper definition develop loft.ghx (Grasshopper 0.9.76)
# plug-ins: Python Interpreter

crv = Curve(<curve referenced from the Rhino model>)
crv_2 = Curve(<curve referenced from the Rhino model>)
python = PythonScript(Crv1=crv, Crv2=crv_2, res=Slider(100, range=0..100))  # -> out, a, b; inputs Crv1: Curve, Crv2: Curve, res: Int32
# ---------- python: Python ----------
import rhinoscriptsyntax as rs

Crv1Seg = rs.DivideCurve(Crv1, res)
Crv2Seg = rs.DivideCurve(Crv2, res)
PlList1 = []
PlList2 = []

for i in range (0,res):
    Pt1 = Crv1Seg[i]
    Pt2 = Crv2Seg[i]
    Pt3 = Crv1Seg[i+1]
    Pl1 = rs.AddPolyline((Pt1,Pt2,Pt3,Pt1))
    PlList1.append(Pl1)
    
for i in range (1,(res+1)):
    Pt1 = Crv1Seg[i]
    Pt2 = Crv2Seg[i]
    Pt3 = Crv2Seg[i-1]
    Pl2 = rs.AddPolyline((Pt1,Pt2,Pt3,Pt1))
    PlList2.append(Pl2)


a = PlList1
b = PlList2
# ---------- end python ----------
boundary = BoundarySurfaces(Edges=[python.a, python.b])
join = BrepJoin(Breps=boundary)  # -> Breps, Closed
